# Dynamo custom node AttachedTable1_ha.dyf (Dynamo 2.3.1.11775)
# category: Test.standardlaw.attachedtable
# 別表第一の(は)に関するノード
# packages: Test package 0.0.1

building = Input(building: var[]..[])  # プロジェクト情報
attachedTable1_i = Custom[AttachedTable1_i](building=building)  # package Test package; 別表第1の(い)に関するノード
用途による対象床面積合計の取得 = Python(IN[0]=attachedTable1_i)
# ---------- 用途による対象床面積合計の取得.python (39 lines) ----------
# Python 標準ライブラリおよび DesignScript ライブラリをロード
import sys
import clr
clr.AddReference('ProtoGeometry')
from Autodesk.DesignScript.Geometry import *

# このノードへの入力は、リスト形式で IN 変数に格納されます。

nums = IN[0]
"""
nums: 別表第一の(い)による用途からの番号

想定番号:
	1: 用途1
	2: 用途2
	3: 用途3
	4: 用途4
	5: 用途5
	6: 用途6
	-1: 対象外用途

"""
target = {
	1: 200,
	2: 300,
	3: 2000,
	4: 500,
	5: 200,
	6: -1,
	-1: -1,
}

rtn = list()
# この行の下にコードを配置します
for n in nums:
	rtn.append(target[n])
			
# 出力を OUT 変数に割り当てます。
OUT = rtn
# ----------------------------------------
total_area = Output(用途による対象床面積合計の取得)  # "total_area: int[]"; 別表第一(は)における床面積の合計（以上）
