# Dynamo custom node AttachedTable1_i.dyf (Dynamo 2.3.1.11775)
# category: Test.standardlaw.attachedtable
# 別表第1の(い)に関するノード

building = Input(building: var[]..[])  # プロジェクト情報
code_block = CodeBlock { "MarketCategory"; }
getParameterValueByName = Element.GetParameterValueByName(element=building, parameterName=code_block)
code_block_2 = CodeBlock { "劇場"; "映画館"; "演芸場"; "観覧場"; "公会堂"; "集会場"; }
list_create = List.Create(item0=code_block_2.out0, item1=code_block_2.out1, item2=code_block_2.out2, item3=code_block_2.out3, item4=code_block_2.out4, item5=code_block_2.out5)
code_block_3 = CodeBlock { "病院"; "診療所"; "ホテル"; "旅館"; "下宿"; "共同住宅"; "寄宿舎"; }
list_create_2 = List.Create(item0=code_block_3.out0, item1=code_block_3.out1, item2=code_block_3.out2, item3=code_block_3.out3, item4=code_block_3.out4, item5=code_block_3.out5, item6=code_block_3.out6)
code_block_4 = CodeBlock { "学校"; "体育館"; }
list_create_3 = List.Create(item0=code_block_4.out0, item1=code_block_4.out1)
code_block_5 = CodeBlock { "百貨店"; "マーケット"; "展示場"; "キャバレー"; "カフェ"; "ナイトクラブ"; "バー"; "ダンスホール"; "遊技場"; }
list_create_4 = List.Create(item0=code_block_5.out0, item1=code_block_5.out1, item2=code_block_5.out2, item3=code_block_5.out3, item4=code_block_5.out4, item5=code_block_5.out5, item6=code_block_5.out6, item7=code_block_5.out7, item8=code_block_5.out8)
code_block_6 = CodeBlock { "倉庫"; }
list_create_5 = List.Create(item0=code_block_6)
code_block_7 = CodeBlock { "自動車車庫"; "自動車修理工場"; }
list_create_6 = List.Create(item0=code_block_7.out0, item1=code_block_7.out1)
用途による番号取得 = Python(IN[0]=getParameterValueByName, IN[1]=list_create, IN[2]=list_create_2, IN[3]=list_create_3, IN[4]=list_create_4, IN[5]=list_create_5, IN[6]=list_create_6)
# ---------- 用途による番号取得.python (21 lines) ----------
# Python 標準ライブラリおよび DesignScript ライブラリをロード
import sys
import clr
clr.AddReference('ProtoGeometry')
from Autodesk.DesignScript.Geometry import *

# このノードへの入力は、リスト形式で IN 変数に格納されます。
building_category = IN[0]
categories = IN[1:]

nums = list()
# この行の下にコードを配置します
for i, bc in enumerate(building_category):
	nums.append(-1)
	for j, c in enumerate(categories):
		if bc in c:
			nums[i] = j + 1
			break
			
# 出力を OUT 変数に割り当てます。
OUT = nums
# ----------------------------------------
numbers = Output(用途による番号取得)  # "numbers: var[]..[]"; 別表第一番号
