# Dynamo custom node AttachedTable1_ro.dyf (Dynamo 2.3.1.11775)
# category: Test.standardlaw.attachedtable
# 別表第一の(ろ)に関するノード
# packages: Test package 0.0.1

building = Input(building: var[]..[])  # プロジェクト情報
attachedTable1_i = Custom[AttachedTable1_i](building=building)  # package Test package; 別表第1の(い)に関するノード
対象番号 = CodeBlock { 1; 2; 3; 4; 6; }
list_create = List.Create(item0=対象番号.out0, item1=対象番号.out1, item2=対象番号.out2, item3=対象番号.out3, item4=対象番号.out4)
用途による対象階の取得 = Python(IN[0]=attachedTable1_i, IN[1]=list_create)
# ---------- 用途による対象階の取得.python (34 lines) ----------
# Python 標準ライブラリおよび DesignScript ライブラリをロード
import sys
import clr
clr.AddReference('ProtoGeometry')
from Autodesk.DesignScript.Geometry import *

# このノードへの入力は、リスト形式で IN 変数に格納されます。
nums = IN[0]
"""
nums: 別表第一の(い)による用途からの番号

想定番号:
	1: 用途1
	2: 用途2
	3: 用途3
	4: 用途4
	5: 用途5
	6: 用途6
	-1: 対象外用途

"""

target = IN[1]

rtn = list()
# この行の下にコードを配置します
for n in nums:
	if n in target:
		rtn.append(3)
	else:
		rtn.append(-1)
			
# 出力を OUT 変数に割り当てます。
OUT = rtn
# ----------------------------------------
storey_number = Output(用途による対象階の取得)  # "storey_number: int[]"; 別表第一(ろ)における階
