# Dynamo custom node boolParamFilter.dyf (Dynamo 2.3.1.11775)
# category: Test.ifc.filter
# bool型のPsetのElementsを分ける

element = Input(element: var[]..[])  # Elements
param = Input(param: string)  # Parameter
getParameterValueByName = Element.GetParameterValueByName(element=element, parameterName=param)
value = Input(value: bool = true)  # Target parameter value
boolParamFilter = Python(IN[0]=element, IN[1]=getParameterValueByName, IN[2]=value)
# ---------- boolParamFilter.python (24 lines) ----------
# Python 標準ライブラリおよび DesignScript ライブラリをロード
import sys
import clr
clr.AddReference('ProtoGeometry')
from Autodesk.DesignScript.Geometry import *

# このノードへの入力は、リスト形式で IN 変数に格納されます。
elements = IN[0]
params = IN[1]
flag = IN[2]

ok = list()
ng = list()

	
# この行の下にコードを配置します
for e, p in zip(elements, params):
	if p == int(flag):
		ok.append(e)
	else:
		ng.append(e)
		
# 出力を OUT 変数に割り当てます。
OUT = [ok, ng]
# ----------------------------------------
code_block = CodeBlock { 0; 1; }
getItemAtIndex = List.GetItemAtIndex(list=boolParamFilter, index=code_block.out0)
ok = Output(getItemAtIndex)  # 適合Elements
getItemAtIndex_2 = List.GetItemAtIndex(list=boolParamFilter, index=code_block.out1)
ng = Output(getItemAtIndex_2)  # 不適合Elements
