# Dynamo custom node intParamFilter.dyf (Dynamo 2.3.1.11775)
# category: Test.ifc.filter
# 数値型プロパティに対するフィルター

element = Input(element: var[]..[])  # Elements
param = Input(param: string)  # Parameter
getParameterValueByName = Element.GetParameterValueByName(element=element, parameterName=param)
values = Input(values: var[]..[])  # Target parameter values
logic = Input(logic: string = "==")  # Logic for Param (defalt is equal)
python_script = Python(IN[0]=element, IN[1]=getParameterValueByName, IN[2]=values, IN[3]=logic)
# ---------- python_script.python (62 lines) ----------
# Python 標準ライブラリおよび DesignScript ライブラリをロード
import sys
import clr
clr.AddReference('ProtoGeometry')
from Autodesk.DesignScript.Geometry import *

import operator

# このノードへの入力は、リスト形式で IN 変数に格納されます。
def tolist(obj1):
	if hasattr(obj1,"__iter__"):
		return obj1
	else: 
		return [obj1]

elements = IN[0]
params = IN[1]
compare_values = tolist(IN[2])
const = True
oper = IN[3]

ops = {
    '==' : operator.eq,
	'<' : operator.lt,
	'<=' : operator.le,
	'>' : operator.gt,
	'>=' : operator.ge,
	'!=' : operator.ne,
}

ok = list()
ng = list()

def check_2i(s):
	try:
		i = int(s)
		return True
	except:
		return False

def eval_binary_expr(op1, oper, op2):
    return ops[oper](op1, op2)
	
# この行の下にコードを配置します
if len(elements) == len(compare_values):
	const = False

for i, e in enumerate(elements):
	p = params[i]
	if check_2i(p):
		if const:
			compare_value = compare_values[0]
		else:
			compare_value = compare_values[i]
			
		if eval_binary_expr(int(p), oper, int(compare_value)):
			ok.append(e)
			continue
	ng.append(e)
		
# 出力を OUT 変数に割り当てます。
OUT = [ok, ng]
# ----------------------------------------
code_block = CodeBlock { 0; 1; }
getItemAtIndex = List.GetItemAtIndex(list=python_script, index=code_block.out0)
ok = Output(getItemAtIndex)  # 適合Elements
getItemAtIndex_2 = List.GetItemAtIndex(list=python_script, index=code_block.out1)
ng = Output(getItemAtIndex_2)  # 不適合Elements
