# Dynamo custom node intSumParamJudge.dyf (Dynamo 2.3.1.11775)
# category: Test.ifc.judge
# 全てのエレメントのパラメータの合計値を判定する

element = Input(element: var[]..[])  # Elements
param = Input(param: string)  # Parameter
getParameterValueByName = Element.GetParameterValueByName(element=element, parameterName=param)
value = Input(value: int)  # Target parameter values
logic = Input(logic: string = "==")  # Logic for Param (defalt is equal)
python_script = Python(IN[0]=getParameterValueByName, IN[1]=value, IN[2]=logic)
# ---------- python_script.python (34 lines) ----------
# Python 標準ライブラリおよび DesignScript ライブラリをロード
import sys
import clr
clr.AddReference('ProtoGeometry')
from Autodesk.DesignScript.Geometry import *

import operator

# このノードへの入力は、リスト形式で IN 変数に格納されます。
params = IN[0]
compare_value = IN[1]
oper = IN[2]

ops = {
    '==' : operator.eq,
	'<' : operator.lt,
	'<=' : operator.le,
	'>' : operator.gt,
	'>=' : operator.ge,
	'!=' : operator.ne,
}

flag = False

def eval_binary_expr(op1, oper, op2):
    return ops[oper](op1, op2)
	
# この行の下にコードを配置します
total = sum(params)

flag = eval_binary_expr(total, oper, compare_value)
		
# 出力を OUT 変数に割り当てます。
OUT = flag
# ----------------------------------------
judge = Output(python_script)  # "judge: bool"; 判定結果
