# Dynamo custom node law21_1.dyf (Dynamo 2.3.1.11775)
# category: Test.standardlaw.body
# 基準法21条1項の判定
# packages: Test package 0.0.1

categories = Categories("OST_Walls")
categories_2 = Categories("OST_StructuralColumns")
categories_3 = Categories("OST_Floors")
categories_4 = Categories("OST_StructuralFraming")
list_create = List.Create(item0=categories, item1=categories_2, item2=categories_3, item3=categories_4)
element = Input(element: var[]..[])  # Elements
elementsFilterByCategory = Custom[elementsFilterByCategory](Categories=list_create, elements=element)  # package Test package; カテゴリで要素をフィルタリングする
code_block = CodeBlock { "FireRating"; 45; 30; ">="; }
intParamFilter = Custom[intParamFilter](element=elementsFilterByCategory, param=code_block.out0, value=code_block.out1, logic=code_block.out3)  # package Test package; 数値型プロパティに対するフィルター
categories_5 = Categories("OST_Roofs")
categories_6 = Categories("OST_Stairs")
list_create_2 = List.Create(item0=categories_5, item1=categories_6)
elementsFilterByCategory_2 = Custom[elementsFilterByCategory](Categories=list_create_2, elements=element)
intParamFilter_2 = Custom[intParamFilter](element=elementsFilterByCategory_2, param=code_block.out0, value=code_block.out2, logic=code_block.out3)
join = List.Join(list0=intParamFilter.ng, list1=intParamFilter_2.ng)
ng = Output(join)  # 不適合Elements
join_2 = List.Join(list0=intParamFilter.ok, list1=intParamFilter_2.ok)
ok = Output(join_2)  # 適合Elements
