# Dynamo custom node logicalANDSwitch.dyf (Dynamo 2.3.1.11775)
# category: Test.utils
# boolフィールドの値がすべてtrueの場合値を通過させます

value = Input(value: var[]..[])  # 値
bools = Input(bools: var[]..[])  # boolリスト
論理積スイッチ = Python(IN[0]=value, IN[1]=bools)
# ---------- 論理積スイッチ.python (19 lines) ----------
# Python 標準ライブラリおよび DesignScript ライブラリをロード
import sys
import clr
clr.AddReference('ProtoGeometry')
from Autodesk.DesignScript.Geometry import *

# このノードへの入力は、リスト形式で IN 変数に格納されます。
value = IN[0]
bools = IN[1]

if type(bools) is not list:
	bools = [bools]

# この行の下にコードを配置します
if all(bools):
	OUT = value
else:
	OUT = "Falseの値が含まれているためキャンセルされました。"
# 出力を OUT 変数に割り当てます。
# ----------------------------------------
value_2 = Output(論理積スイッチ)  # "value"; 値
