# Dynamo custom node logicalORSwitch.dyf (Dynamo 2.3.1.11775)
# category: Test.utils
# boolsフィールドの値のうちどれか一つがtrueの場合値を通過させる

value = Input(value: var[]..[])  # 値
bools = Input(bools: var[]..[])  # boolリスト
論理和スイッチ = Python(IN[0]=value, IN[1]=bools)
# ---------- 論理和スイッチ.python (19 lines) ----------
# Python 標準ライブラリおよび DesignScript ライブラリをロード
import sys
import clr
clr.AddReference('ProtoGeometry')
from Autodesk.DesignScript.Geometry import *

# このノードへの入力は、リスト形式で IN 変数に格納されます。
value = IN[0]
bools = IN[1]

if type(bools) is not list:
	bools = [bools]

# この行の下にコードを配置します
if any(bools):
	OUT = value
else:
	OUT = "trueが含まれないため値が通過しませんでした。"
# 出力を OUT 変数に割り当てます。
# ----------------------------------------
value_2 = Output(論理和スイッチ)  # "value"; 値
