# Dynamo custom node mainStrucElements.dyf (Dynamo 2.3.1.11775)
# category: Test.standardlaw.definition
# 主要構造部Elements
# packages: Test package 0.0.1

categories = Categories("OST_Walls")
all_elements_of_category = ElementsOfCategory(Category=categories)
code_block = CodeBlock { "LoadBearing"; }
boolean = BoolSelector(true)
boolParamFilter = Custom[boolParamFilter](element=all_elements_of_category, param=code_block, value=boolean)  # package Test package; bool型のPsetのElementsを分ける
wall = Input(wall: bool = true)  # 壁
logicalANDSwitch = Custom[logicalANDSwitch](value=boolParamFilter.ok, bools=wall)  # package Test package; boolフィールドの値がすべてtrueの場合値を通過させます
categories_2 = Categories("OST_StructuralColumns")
all_elements_of_category_2 = ElementsOfCategory(Category=categories_2)
code_block_2 = CodeBlock { "LoadBearing"; }
boolean_2 = BoolSelector(true)
boolParamFilter_2 = Custom[boolParamFilter](element=all_elements_of_category_2, param=code_block_2, value=boolean_2)
column = Input(column: bool = true)  # 構造柱
logicalANDSwitch_2 = Custom[logicalANDSwitch](value=boolParamFilter_2.ok, bools=column)
categories_3 = Categories("OST_Floors")
all_elements_of_category_3 = ElementsOfCategory(Category=categories_3)
code_block_3 = CodeBlock { "LoadBearing"; }
boolean_3 = BoolSelector(true)
boolParamFilter_3 = Custom[boolParamFilter](element=all_elements_of_category_3, param=code_block_3, value=boolean_3)
slab = Input(slab: bool = true)  # 床
logicalANDSwitch_3 = Custom[logicalANDSwitch](value=boolParamFilter_3.ok, bools=slab)
categories_4 = Categories("OST_StructuralFramingSystem")
all_elements_of_category_4 = ElementsOfCategory(Category=categories_4)
code_block_4 = CodeBlock { "LoadBearing"; }
boolean_4 = BoolSelector(true)
boolParamFilter_4 = Custom[boolParamFilter](element=all_elements_of_category_4, param=code_block_4, value=boolean_4)
beam = Input(beam: bool = true)  # 梁
logicalANDSwitch_4 = Custom[logicalANDSwitch](value=boolParamFilter_4.ok, bools=beam)
categories_5 = Categories("OST_Roofs")
all_elements_of_category_5 = ElementsOfCategory(Category=categories_5)
code_block_5 = CodeBlock { "LoadBearing"; }
boolean_5 = BoolSelector(true)
boolParamFilter_5 = Custom[boolParamFilter](element=all_elements_of_category_5, param=code_block_5, value=boolean_5)
roof = Input(roof: bool = true)  # 屋根
logicalANDSwitch_5 = Custom[logicalANDSwitch](value=boolParamFilter_5.ok, bools=roof)
categories_6 = Categories("OST_Stairs")
all_elements_of_category_6 = ElementsOfCategory(Category=categories_6)
code_block_6 = CodeBlock { "LoadBearing"; }
boolean_6 = BoolSelector(true)
boolParamFilter_6 = Custom[boolParamFilter](element=all_elements_of_category_6, param=code_block_6, value=boolean_6)
stair = Input(stair: bool = true)  # 階段
logicalANDSwitch_6 = Custom[logicalANDSwitch](value=boolParamFilter_6.ok, bools=stair)
join = List.Join(list0=logicalANDSwitch, list1=logicalANDSwitch_2, list2=logicalANDSwitch_3, list3=logicalANDSwitch_4, list4=logicalANDSwitch_5, list5=logicalANDSwitch_6)
element = Output(join)  # 主要構造部Element
