# Dynamo custom node setColorOnElement.dyf (Dynamo 2.3.1.11775)
# category: Test.utils
# 指定したElementに着色を行う

element = Input(element: Revit.Elements.Element)
cutFillColor = Input(cutFillColor: DSCore.Color)
byProperties = Revit.Filter.OverrideGraphicSettings.ByProperties(cutFillColor=cutFillColor, projectionFillColor=cutFillColor, cutLineColor=cutFillColor, projectionLineColor=cutFillColor)
overrideInView = Element.OverrideInView(element=element, overrides=byProperties)
Element = Output(overrideInView)
