# Dynamo custom node setColorOnOKandNG.dyf (Dynamo 2.3.1.11775)
# category: Test.utils
# 適合要素と不適合要素にそれぞれ着色を行う

list = Input(list: var)  # Elements(List[List[Element]]): リストに入れられた要素)
code_block = CodeBlock { 0; 1; }
getItemAtIndex = List.GetItemAtIndex(list=list, index=code_block.out0)
cutFillColor1 = Input(cutFillColor1: DSCore.Color)  # color(color): 色１
byProperties = Revit.Filter.OverrideGraphicSettings.ByProperties(cutFillColor=cutFillColor1, projectionFillColor=cutFillColor1, cutLineColor=cutFillColor1, projectionLineColor=cutFillColor1)
overrideInView = Element.OverrideInView(element=getItemAtIndex, overrides=byProperties)
Element = Output(overrideInView)
getItemAtIndex_2 = List.GetItemAtIndex(list=list, index=code_block.out1)
cutFillColor2 = Input(cutFillColor2: DSCore.Color)  # color(color): 色2
byProperties_2 = Revit.Filter.OverrideGraphicSettings.ByProperties(cutFillColor=cutFillColor2, projectionFillColor=cutFillColor2, cutLineColor=cutFillColor2, projectionLineColor=cutFillColor2)
overrideInView_2 = Element.OverrideInView(element=getItemAtIndex_2, overrides=byProperties_2)
Element_2 = Output(overrideInView_2)  # "Element"
