# Dynamo custom node stringParamFilter.dyf (Dynamo 2.3.1.11775)
# category: Test.ifc.filter
# stringのパラメータのElementsをFilterする

element = Input(element: var[]..[])  # Elements
param = Input(param: string)  # Parameter
getParameterValueByName = Element.GetParameterValueByName(element=element, parameterName=param)
values = Input(values: string[])  # Target parameter values
python_script = Python(IN[0]=element, IN[1]=getParameterValueByName, IN[2]=values)
# ---------- python_script.python (26 lines) ----------
# Python 標準ライブラリおよび DesignScript ライブラリをロード
import sys
import clr
clr.AddReference('ProtoGeometry')
from Autodesk.DesignScript.Geometry import *

# このノードへの入力は、リスト形式で IN 変数に格納されます。
elements = IN[0]
params = IN[1]
correct_values = IN[2]

ok = list()
ng = list()

if type(correct_values) is str:
	correct_values = [correct_values]
	
# この行の下にコードを配置します
for e, p in zip(elements, params):
	if p in correct_values:
		ok.append(e)
	else:
		ng.append(e)
		
# 出力を OUT 変数に割り当てます。
OUT = [ok, ng]
# ----------------------------------------
code_block = CodeBlock { 0; 1; }
getItemAtIndex = List.GetItemAtIndex(list=python_script, index=code_block.out0)
ok = Output(getItemAtIndex)  # 適合Elements
getItemAtIndex_2 = List.GetItemAtIndex(list=python_script, index=code_block.out1)
ng = Output(getItemAtIndex_2)  # 不適合Elements
