# Dynamo custom node stringParamJudge.dyf (Dynamo 2.3.1.11775)
# category: Test.ifc.judge
# 一つのElementに対する文字列パラメータの判定を行う

element = Input(element: var[]..[])  # Elements
param = Input(param: string)  # Parameter
getParameterValueByName = Element.GetParameterValueByName(element=element, parameterName=param)
values = Input(values: string[])  # Target parameter values
python_script = Python(IN[0]=element, IN[1]=getParameterValueByName, IN[2]=values)
# ---------- python_script.python (20 lines) ----------
# Python 標準ライブラリおよび DesignScript ライブラリをロード
import sys
import clr
clr.AddReference('ProtoGeometry')
from Autodesk.DesignScript.Geometry import *

# このノードへの入力は、リスト形式で IN 変数に格納されます。
params = IN[0]
correct_values = IN[1]

flag = True

# この行の下にコードを配置します
for p in params:
	if p not in correct_values:
		flag = False
		break
		
# 出力を OUT 変数に割り当てます。
OUT = flag
# ----------------------------------------
judge = Output(python_script)  # "judge: bool"; 判定結果
